# Grasshopper definition 20250622_tools.gh (Grasshopper 1.0.8)
# plug-ins: NGon_RH8

point = Point(<point referenced from the Rhino model>)
deconstruct = Deconstruct(Point=point)  # -> XComponent, YComponent, ZComponent

# ----
# In Progress
panel = Panel("/Users/yang/GitHub/20231106_Innovedum/webServer/SBII_Ex2_prestressing")  # disabled
panel_2 = Panel("torsion")  # disabled
info = GhPythonScript(name=panel_2, address=panel)  # disabled
# ---------- info: Python ----------
__author__ = "yang"

import rhinoscriptsyntax as rs
import scriptcontext as sc

sc.sticky["project_name"] = name
sc.sticky["address"] = address
# ---------- end info ----------

# ----
# Export Lines
panel_3 = Panel("C:\D\GitHub\webServer\SBII_Ex2_prestressing\json")
# Export Texts
panel_4 = Panel("C:\D\GitHub\webServer\SBII_Ex2_prestressing\text")
# Export Meshes
mesh = Mesh([<mesh referenced from the Rhino model> x12])

toggle = BooleanToggle(True)  # disabled
button = Button()  # disabled
id = Guid([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])  # disabled
python = GhPythonScript(guids=id, write=toggle)  # -> out, a; inputs guids: list of Guid, write: Boolean; disabled
# ---------- python: Python ----------
__author__ = "Wenqian"
__version__ = "2025.03.05"

import rhinoscriptsyntax as rs
import scriptcontext as sc
import Rhino
import json
import os
import System

names = {}
lines = {}
texts = {}
meshes = {}

sc.doc = Rhino.RhinoDoc.ActiveDoc
for guid in guids:
    obj = sc.doc.Objects.Find(guid)
    layer_index = obj.Attributes.LayerIndex
    name = sc.doc.Layers[layer_index].FullPath
    names.update({name: {"content":[], "color": (), "material": ""}})
    type = rs.ObjectType(guid)
    if type == 4:
        lines.update({name: []})
    elif type == 512:
        texts.update({name: []})
    elif type == 32:
        meshes.update({name: []})

for guid in guids:
    obj = sc.doc.Objects.Find(guid)
    layer_index = obj.Attributes.LayerIndex
    name = sc.doc.Layers[layer_index].FullPath
    type = rs.ObjectType(guid)
    names[name]["content"].append(type)
    if type == 4:
        line = obj.Geometry
        lines[name].append(line)
    elif type == 512:
        text = obj.Geometry
        texts[name].append(text)
    elif type == 32:
        mesh = obj.Geometry
        meshes[name].append(mesh)

for key, value in names.items():
    sortedlist = list(set(value["content"]))
    value.update({"content": sortedlist})

    color = rs.LayerColor(key)
    value["color"] = (int(color.R), int(color.G), int(color.B))

    layer_index = sc.doc.Layers.FindByFullPath(key, True)
    layer = sc.doc.Layers[layer_index]
    material = sc.doc.Materials[layer.RenderMaterialIndex]
    value["material"] = material.Name

sorted_dict =dict(sorted(names.items()))
a = sorted_dict

layer_objects = []
for key, value in sorted_dict.items():
    layer_objects.append({"name": key, "content": value["content"], "color": value["color"], "material": value["material"]})


def write_mesh(name, meshes):
    mesh = Rhino.Geometry.Mesh()
    for m in meshes:
            mesh.Append(m)

    file_path = os.path.join(address, name + ".obj")
    arr = System.Array[Rhino.Geometry.Mesh]([mesh])
    success = Rhino.FileIO.FileObj.Write(file_path, arr, options)

def write_line(name, lines):
    jsonContent = []
    for i in range(len(lines)):
        jsonContent.append(
        [[lines[i].PointAt(0).X,
        lines[i].PointAt(0).Y,
        lines[i].PointAt(0).Z],
        [lines[i].PointAt(1).X,
        lines[i].PointAt(1).Y,
        lines[i].PointAt(1).Z]]
        )
    jsonContent = {"lines": jsonContent}
    jsonObj = json.dumps(jsonContent, indent=4)
    
    path = os.path.join(address, name +".json")
    
    with open(path, "w") as outFile:
        outFile.write(jsonObj)

def write_text(name, texts):
    strings = [text.Text for text in texts]
    locations = [text.Plane for text in texts]
    content = []
    for i in range(len(texts)):
    
        item = {
        "text":strings[i],
        "pt":[locations[i].OriginX, locations[i].OriginY, locations[i].OriginZ]}
        
        content.append(item)
    
    content = {"text3d": content}
    jsonObj = json.dumps(content, indent=4)
    
    fileName = name
    path = os.path.join(address, "text_" + name+".json")
    
    with open(path, "w") as outFile:
        outFile.write(jsonObj)

project_name = address = ""
if "project_name" in sc.sticky:
    project_name = sc.sticky["project_name"]
if "address" in sc.sticky:
    address = sc.sticky["address"]
fwo = Rhino.FileIO.FileWriteOptions()
options = Rhino.FileIO.FileObjWriteOptions(fwo) 

if write and project_name != "" and address != "":
    layer_objects = json.dumps(layer_objects, indent=4)
    path = os.path.join(address, "layers.json")
    with open(path, "w") as out_file:
        out_file.write(layer_objects)

    for key, value in lines.items():
        write_line(key, value)

    for key, value in texts.items():
        write_text(key, value)
    
    for key, value in meshes.items():
        write_mesh(key, value)
# ---------- end python ----------
button_2 = Button()  # disabled
python_2 = GhPythonScript(write=button_2)  # -> out, a; inputs steps: list, write: Boolean; disabled
# ---------- python_2: Python ----------
__author__ = "yang"

import rhinoscriptsyntax as rs
import scriptcontext as sc
import json
import os

# make step json file
step_objects = []
for i in range(len(steps)):
    # int_list = [int(a) for a in steps]
    step_objects.append(steps[i]);

if "project_name" in sc.sticky:
    project_name = sc.sticky["name"]

if "address" in sc.sticky:
    address = sc.sticky["address"]

if write and project_name != "" and address != "":
    step_output = json.dumps(step_objects, indent=4)
    path = os.path.join(address, "steps.json")
    with open(path, "w") as out_file:
        out_file.write(step_output)
# ---------- end python_2 ----------
panel_5 = Panel(python_2.out)  # disabled

number_slider = Slider(0.01, range=0..0.1)
point_2 = Point(<point referenced from the Rhino model>)
# Mesh Pipes in LowPoly
crv = Curve([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])
deconstruct_2 = Deconstruct(Point=point_2)  # -> XComponent, YComponent, ZComponent
id_2 = Guid([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])
id_3 = Guid([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])
boolean_toggle = BooleanToggle(True)
id_4 = Guid(mesh)
meshpipe = MeshPipe(Curve=crv, Radius=Slider(0.005, range=0..0.01), Sides=Slider(4, range=0..10), Tolerance=10, Ending=3)
python_3 = GhPythonScript(guid=id_4)  # -> out, full_name; inputs guid: Guid
# ---------- python_3: Python ----------
__author__ = "yang"

import rhinoscriptsyntax as rs
import scriptcontext as sc
import Rhino

sc.doc = Rhino.RhinoDoc.ActiveDoc
obj = sc.doc.Objects.Find(guid)
layer_index = obj.Attributes.LayerIndex
full_name = sc.doc.Layers[layer_index].FullPath
print(full_name)
sc.doc = ghdoc
# ---------- end python_3 ----------
python_4 = GhPythonScript(guids=id_2, address=panel_3, write=Button())  # -> out, a; inputs guids: list of Guid, write: Boolean
# ---------- python_4: Python ----------
__author__ = "Wenqian"
__version__ = "2025.03.05"

import rhinoscriptsyntax as rs
import scriptcontext as sc
import Rhino
import json
import os
import System

lines = {}

sc.doc = Rhino.RhinoDoc.ActiveDoc
for guid in guids:
    obj = sc.doc.Objects.Find(guid)
    layer_index = obj.Attributes.LayerIndex
    name = sc.doc.Layers[layer_index].FullPath
    type = rs.ObjectType(guid)
    if type == 4:
        lines.update({name: []})

for guid in guids:
    obj = sc.doc.Objects.Find(guid)
    layer_index = obj.Attributes.LayerIndex
    name = sc.doc.Layers[layer_index].FullPath
    type = rs.ObjectType(guid)
    if type == 4:
        line = obj.Geometry
        lines[name].append(line)

def write_line(name, lines):
    jsonContent = []
    for i in range(len(lines)):
        line = rs.coercecurve(lines[i])
        jsonContent.append(
        [[line.PointAtStart.X,
        line.PointAtStart.Y,
        line.PointAtStart.Z],
        [line.PointAtEnd.X,
        line.PointAtEnd.Y,
        line.PointAtEnd.Z]]
        )
        print(lines[i].PointAt(0),lines[i].PointAt(1))
    jsonContent = {"lines": jsonContent}
    jsonObj = json.dumps(jsonContent, indent=4)
    
    path = os.path.join(address, name +".json")
    
    with open(path, "w") as outFile:
        outFile.write(jsonObj)

fwo = Rhino.FileIO.FileWriteOptions()
options = Rhino.FileIO.FileObjWriteOptions(fwo) 

if write:
    for key, value in lines.items():
        write_line(key, value)
# ---------- end python_4 ----------
python_5 = GhPythonScript(guids=id_3, address=panel_4, write=Button())  # -> out, a; inputs guids: list of Guid, write: Boolean
# ---------- python_5: Python ----------
__author__ = "Wenqian"
__version__ = "2025.03.05"

import rhinoscriptsyntax as rs
import scriptcontext as sc
import Rhino
import json
import os
import System

texts = {}

sc.doc = Rhino.RhinoDoc.ActiveDoc
for guid in guids:
    obj = sc.doc.Objects.Find(guid)
    layer_index = obj.Attributes.LayerIndex
    name = sc.doc.Layers[layer_index].FullPath
    type = rs.ObjectType(guid)
    if type == 512:
        texts.update({name: []})

for guid in guids:
    obj = sc.doc.Objects.Find(guid)
    layer_index = obj.Attributes.LayerIndex
    name = sc.doc.Layers[layer_index].FullPath
    type = rs.ObjectType(guid)
    if type == 512:
        text = obj.Geometry
        texts[name].append(text)

def write_text(name, texts):
    strings = [text.Text for text in texts]
    locations = [text.Plane for text in texts]
    content = []
    for i in range(len(texts)):
    
        item = {
        "pt":[locations[i].OriginX, locations[i].OriginY, locations[i].OriginZ],
        "text":strings[i]}
        
        content.append(item)
    
    content = {"text3d": content}
    jsonObj = json.dumps(content, indent=4)
    
    fileName = name
    path = os.path.join(address, name+".json")
    
    with open(path, "w") as outFile:
        outFile.write(jsonObj)

fwo = Rhino.FileIO.FileWriteOptions()
options = Rhino.FileIO.FileObjWriteOptions(fwo) 

if write:
    for key, value in texts.items():
        write_text(key, value)
# ---------- end python_5 ----------
panel_7 = Panel(python_5.out)
panel_8 = Panel(python_4.out)
c_script = CSharpScript(
    in_run=Button(),
    in_mesh=graft(mesh),
    in_name=graft(python_3.full_name),
    in_path="C:\D\GitHub\webServer\SBII_Ex2_prestressing\obj\")  # -> out, A; inputs in_run: Boolean, in_mesh: list of Mesh, in_name: String, in_path: String
# ---------- c_script: C# ----------
    if(in_run) {
      path = System.IO.Path.GetDirectoryName(in_path) + "\\" + in_name + ".obj";
      int faceCount = 0;
      using(StreamWriter writer = new StreamWriter(path)) {
        for(int n = 0; n < in_mesh.Count; n++) {
          List<String> vert = new List<String>();
          List<String> face = new List<String>();

          in_mesh[n].Faces.ConvertQuadsToTriangles();
          BoundingBox bbox = in_mesh[n].GetBoundingBox(true);

          for(int i = 0; i < in_mesh[n].Vertices.Count; i++) {
            vert.Add(String.Format("v {0} {1} {2}", -in_mesh[n].Vertices[i].X, in_mesh[n].Vertices[i].Z, in_mesh[n].Vertices[i].Y));
          }

          for(int i = 0; i < in_mesh[n].TextureCoordinates.Count; i++) {
            double tx = in_mesh[n].TextureCoordinates[i].X;
            double ty = in_mesh[n].TextureCoordinates[i].Y;
            vert.Add(String.Format("vt " + tx.ToString("F6") + " " + ty.ToString("F6")));
          }

          for(int i = 0; i < in_mesh[n].Normals.Count; i++) {
            vert.Add(String.Format("vn {0} {1} {2}", -in_mesh[n].Normals[i].X, in_mesh[n].Normals[i].Z, in_mesh[n].Normals[i].Y));
          }

          for(int i = 0; i < in_mesh[n].Faces.Count; i++) {
            MeshFace f = in_mesh[n].Faces.GetFace(i);
            int fa = f.A + 1 + faceCount;
            int fb = f.B + 1 + faceCount;
            int fc = f.C + 1 + faceCount;
            string fas = fa.ToString();
            string fbs = fb.ToString();
            string fcs = fc.ToString();
            face.Add(String.Format("f " + fas + "/" + fas + "/" + fas + " " + fbs + "/" + fbs + "/" + fbs + " " + fcs + "/" + fcs + "/" + fcs));
          }

          for(int i = 0; i < vert.Count; i++) {
            writer.WriteLine(vert[i]);
          }

          writer.WriteLine("");
          writer.WriteLine("g " + in_name + n.ToString());

          for(int i = 0; i < face.Count; i++) {
            writer.WriteLine(face[i]);
          }
          faceCount += in_mesh[n].Vertices.Count;
        }
      }
    }
    A = path;
# ---------- c_script: C# additional code ----------
  String path;
# ---------- end c_script ----------
