# Grasshopper definition Tools.gh (Grasshopper 1.0.8)

panel = Panel("/Users/yang/GitHub/20231106_Innovedum/webServer/SBII_Ex2_prestressing")
info = GhPythonScript(name="torsion", address=panel)
# ---------- info: Python ----------
__author__ = "yang"

import rhinoscriptsyntax as rs
import scriptcontext as sc

sc.sticky["project_name"] = name
sc.sticky["address"] = address
# ---------- end info ----------

button = Button()
id = Guid([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])
python = GhPythonScript(guids=id, write=Toggle(True))  # -> out, a; inputs guids: list of Guid, write: Boolean
# ---------- python: Python ----------
__author__ = "Wenqian"
__version__ = "2025.03.05"

import rhinoscriptsyntax as rs
import scriptcontext as sc
import Rhino
import json
import os
import System

names = {}
lines = {}
texts = {}
meshes = {}

sc.doc = Rhino.RhinoDoc.ActiveDoc
for guid in guids:
    obj = sc.doc.Objects.Find(guid)
    layer_index = obj.Attributes.LayerIndex
    name = sc.doc.Layers[layer_index].FullPath
    names.update({name: {"content":[], "color": (), "material": ""}})
    type = rs.ObjectType(guid)
    if type == 4:
        lines.update({name: []})
    elif type == 512:
        texts.update({name: []})
    elif type == 32:
        meshes.update({name: []})

for guid in guids:
    obj = sc.doc.Objects.Find(guid)
    layer_index = obj.Attributes.LayerIndex
    name = sc.doc.Layers[layer_index].FullPath
    type = rs.ObjectType(guid)
    names[name]["content"].append(type)
    if type == 4:
        line = obj.Geometry
        lines[name].append(line)
    elif type == 512:
        text = obj.Geometry
        texts[name].append(text)
    elif type == 32:
        mesh = obj.Geometry
        meshes[name].append(mesh)

for key, value in names.items():
    sortedlist = list(set(value["content"]))
    value.update({"content": sortedlist})

    color = rs.LayerColor(key)
    value["color"] = (int(color.R), int(color.G), int(color.B))

    layer_index = sc.doc.Layers.FindByFullPath(key, True)
    layer = sc.doc.Layers[layer_index]
    material = sc.doc.Materials[layer.RenderMaterialIndex]
    value["material"] = material.Name

sorted_dict =dict(sorted(names.items()))
a = sorted_dict

layer_objects = []
for key, value in sorted_dict.items():
    layer_objects.append({"name": key, "content": value["content"], "color": value["color"], "material": value["material"]})


def write_mesh(name, meshes):
    mesh = Rhino.Geometry.Mesh()
    for m in meshes:
            mesh.Append(m)

    file_path = os.path.join(address, name + ".obj")
    arr = System.Array[Rhino.Geometry.Mesh]([mesh])
    success = Rhino.FileIO.FileObj.Write(file_path, arr, options)

def write_line(name, lines):
    jsonContent = []
    for i in range(len(lines)):
        jsonContent.append(
        [[lines[i].PointAt(0).X,
        lines[i].PointAt(0).Y,
        lines[i].PointAt(0).Z],
        [lines[i].PointAt(1).X,
        lines[i].PointAt(1).Y,
        lines[i].PointAt(1).Z]]
        )
    jsonContent = {"lines": jsonContent}
    jsonObj = json.dumps(jsonContent, indent=4)
    
    path = os.path.join(address, name +".json")
    
    with open(path, "w") as outFile:
        outFile.write(jsonObj)

def write_text(name, texts):
    strings = [text.Text for text in texts]
    locations = [text.Plane for text in texts]
    content = []
    for i in range(len(texts)):
    
        item = {
        "text":strings[i],
        "pt":[locations[i].OriginX, locations[i].OriginY, locations[i].OriginZ]}
        
        content.append(item)
    
    content = {"text3d": content}
    jsonObj = json.dumps(content, indent=4)
    
    fileName = name
    path = os.path.join(address, "text_" + name+".json")
    
    with open(path, "w") as outFile:
        outFile.write(jsonObj)

project_name = address = ""
if "project_name" in sc.sticky:
    project_name = sc.sticky["project_name"]
if "address" in sc.sticky:
    address = sc.sticky["address"]
fwo = Rhino.FileIO.FileWriteOptions()
options = Rhino.FileIO.FileObjWriteOptions(fwo) 

if write and project_name != "" and address != "":
    layer_objects = json.dumps(layer_objects, indent=4)
    path = os.path.join(address, "layers.json")
    with open(path, "w") as out_file:
        out_file.write(layer_objects)

    for key, value in lines.items():
        write_line(key, value)

    for key, value in texts.items():
        write_text(key, value)
    
    for key, value in meshes.items():
        write_mesh(key, value)
# ---------- end python ----------
panel_2 = Panel(python.a)
panel_3 = Panel(python.out)
panel_4 = Panel("""0,1,2,3
0,1
1,3,4,5,
11
13,22
10,11
10,2
10,13
10,14
20,21,0
0,4,10""")
python_2 = GhPythonScript(steps=panel_4, write=Button())  # -> out, a; inputs steps: list, write: Boolean
# ---------- python_2: Python ----------
__author__ = "yang"

import rhinoscriptsyntax as rs
import scriptcontext as sc
import json
import os

# make step json file
step_objects = []
for i in range(len(steps)):
    # int_list = [int(a) for a in steps]
    step_objects.append(steps[i]);

if "project_name" in sc.sticky:
    project_name = sc.sticky["name"]

if "address" in sc.sticky:
    address = sc.sticky["address"]

if write and project_name != "" and address != "":
    step_output = json.dumps(step_objects, indent=4)
    path = os.path.join(address, "steps.json")
    with open(path, "w") as out_file:
        out_file.write(step_output)
# ---------- end python_2 ----------
panel_5 = Panel(python_2.out)
