# Grasshopper definition Tools.gh (Grasshopper 1.0.7)
# plug-ins: NGon

# write step information
button = Button()
# write layer information
guid = Guid([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])
# Export Mesh as .obj
mesh = Mesh([<mesh referenced from the Rhino model> x16])
crv = Curve([<curve referenced from the Rhino model> x130])
# Export Lines as JSON
crv_2 = Curve([<curve referenced from the Rhino model> x130])

# ---- group: Reference text objects from Rhino
# Export Text as JSON
id = Guid([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])

# ----
ghpython_script = GhPythonScript(guids=guid, project_name="torsion", address="C:\Users\Wenqian\Desktop", write=button)  # -> out, a; inputs guids: list of Guid, write: Boolean
# ---------- ghpython_script: Python ----------
__author__ = "Wenqian"
__version__ = "2025.03.05"

import rhinoscriptsyntax as rs
import scriptcontext as sc
import Rhino
import json
import os

layer_indexs = []
layer_objects = {}

# collect all layers
sc.doc = Rhino.RhinoDoc.ActiveDoc
for guid in guids:
    obj = sc.doc.Objects.Find(guid)
    layer_index = obj.Attributes.LayerIndex
    layer_indexs.append(layer_index)

layer_indexs = list(set(layer_indexs))
layer_indexs.sort()

for layer_index in layer_indexs:
    layer_objects.update({layer_index: []})

for guid in guids:
    obj = sc.doc.Objects.Find(guid)
    layer_index = obj.Attributes.LayerIndex
    type = rs.ObjectType(guid)
    layer_objects[layer_index].append(type)

layer_object_output = {}
for key, value in layer_objects.items():
    layer_name = sc.doc.Layers[key].FullPath
    content = list(set(value))
    layer_object_output.update({layer_name: content})

a = layer_object_output

if write:
    layer_object_output = json.dumps(layer_object_output, indent=4)
    path = os.path.join(address, project_name + ".json")
    with open(path, "w") as out_file:
        out_file.write(layer_object_output)
# ---------- end ghpython_script ----------
number_slider = Slider(0.01, range=0..0.1)
panel = Panel("\Users\merzpa\Documents\Lehre\Apps\xr-apps\examples\4_tutorial_video\02_OnlineRessources\obj\")
c_script = CSharpScript(id=id)  # -> out, text, plane; inputs id: Guid
# ---------- c_script: C# usings ----------
using System.IO;
using System.Linq;
using System.Data;
using System.Drawing;
using System.Reflection;
using System.Windows.Forms;
using System.Xml;
using System.Xml.Linq;
using System.Runtime.InteropServices;

using Rhino.DocObjects;
using Rhino.Collections;
using GH_IO;
using GH_IO.Serialization;
# ---------- c_script: C# ----------
    RhinoObject ro = RhinoDocument.Objects.Find(id);

    if(ro.ObjectType != ObjectType.Annotation) return;

    TextObject txt = ro as TextObject;

    text = txt.TextGeometry.Text;
    plane = txt.TextGeometry.Plane;
# ---------- end c_script ----------
# Mesh Pipes in LowPoly
crv_3 = Curve([<curve referenced from the Rhino model> x8])
python = GhPythonScript(guid=crv_2)  # -> out, full_name; inputs guid: Guid
# ---------- python: Python ----------
__author__ = "yang"

import rhinoscriptsyntax as rs
import scriptcontext as sc
import Rhino

sc.doc = Rhino.RhinoDoc.ActiveDoc
obj = sc.doc.Objects.Find(guid)
layer_index = obj.Attributes.LayerIndex
full_name = sc.doc.Layers[layer_index].FullPath
print(full_name)
sc.doc = ghdoc
# ---------- end python ----------
button_2 = Button()
panel_2 = Panel(ghpython_script.a)
python_2 = GhPythonScript(guid=crv)  # -> out, full_name; inputs guid: Guid; same code as python
python_3 = GhPythonScript(guid=id)  # -> out, full_name; inputs guid: Guid; same code as python
meshpipe = MeshPipe(Curve=crv_3, Radius=Slider(0.006, range=0..0.01), Sides=Slider(4, range=0..10), Tolerance=10, Ending=3)
id_2 = Guid(mesh)
python_4 = GhPythonScript(guid=id_2)  # -> out, full_name; inputs guid: Guid; same code as python
mesh_2 = Mesh([<mesh referenced from the Rhino model> x23])
python_5 = GhPythonScript(lines=crv_2, writeJson=button_2, fileName=python.full_name, address="/Users/yang/Desktop/")  # -> out, a; inputs lines: list of Line, writeJson: Boolean, fileName: list
# ---------- python_5: Python ----------
__author__ = "yang"

import rhinoscriptsyntax as rs
import Rhino.Geometry as rg
import json
import os

if writeJson:

    fileNameCategory = []

    for name in fileName:
        if name in fileNameCategory:
            pass
        else:
            fileNameCategory.append(name)

    lineAll = []
    for i in range(len(fileNameCategory)):
        categorisedline = []
        for j in range(len(fileName)):
            if fileName[j] == fileNameCategory[i]:
                categorisedline.append(lines[j]);
        lineAll.append(categorisedline)

    for j in range(len(lineAll)):
        jsonContent = []
        lines = lineAll[j]
        for i in range(len(lines)):
            jsonContent.append(
            [[lines[i].PointAt(0).X,
            lines[i].PointAt(0).Y,
            lines[i].PointAt(0).Z],
            [lines[i].PointAt(1).X,
            lines[i].PointAt(1).Y,
            lines[i].PointAt(1).Z]]
            )
        jsonContent = {"lines": jsonContent}
        jsonObj = json.dumps(jsonContent, indent=4)
        
        path = os.path.join(address, fileNameCategory[j]+".json")
        
        with open(path, "w") as outFile:
            outFile.write(jsonObj)
# ---------- end python_5 ----------
python_6 = GhPythonScript(guid=mesh_2)  # -> out, full_name; inputs guid: Guid; same code as python
panel_3 = Panel("""0,1,2,3
0,1
1,3,4,5,
11
13,22
10,11
10,2
10,13
10,14
20""")
path = FilePath(panel)
panel_4 = Panel(python_4.full_name)
c_script_2 = CSharpScript(in_run=Button(), in_mesh=graft(mesh), in_name=graft(python_4.full_name), in_path=path)  # -> out, A; inputs in_run: Boolean, in_mesh: list of Mesh, in_name: String, in_path: String
# ---------- c_script_2: C# ----------
    if(in_run) {
      path = System.IO.Path.GetDirectoryName(in_path) + "\\" + in_name + ".obj";
      int faceCount = 0;
      using(StreamWriter writer = new StreamWriter(path)) {
        for(int n = 0; n < in_mesh.Count; n++) {
          List<String> vert = new List<String>();
          List<String> face = new List<String>();

          in_mesh[n].Faces.ConvertQuadsToTriangles();
          BoundingBox bbox = in_mesh[n].GetBoundingBox(true);

          for(int i = 0; i < in_mesh[n].Vertices.Count; i++) {
            vert.Add(String.Format("v {0} {1} {2}", -in_mesh[n].Vertices[i].X, in_mesh[n].Vertices[i].Z, in_mesh[n].Vertices[i].Y));
          }

          for(int i = 0; i < in_mesh[n].TextureCoordinates.Count; i++) {
            double tx = in_mesh[n].TextureCoordinates[i].X;
            double ty = in_mesh[n].TextureCoordinates[i].Y;
            vert.Add(String.Format("vt " + tx.ToString("F6") + " " + ty.ToString("F6")));
          }

          for(int i = 0; i < in_mesh[n].Normals.Count; i++) {
            vert.Add(String.Format("vn {0} {1} {2}", -in_mesh[n].Normals[i].X, in_mesh[n].Normals[i].Z, in_mesh[n].Normals[i].Y));
          }

          for(int i = 0; i < in_mesh[n].Faces.Count; i++) {
            MeshFace f = in_mesh[n].Faces.GetFace(i);
            int fa = f.A + 1 + faceCount;
            int fb = f.B + 1 + faceCount;
            int fc = f.C + 1 + faceCount;
            string fas = fa.ToString();
            string fbs = fb.ToString();
            string fcs = fc.ToString();
            face.Add(String.Format("f " + fas + "/" + fas + "/" + fas + " " + fbs + "/" + fbs + "/" + fbs + " " + fcs + "/" + fcs + "/" + fcs));
          }

          for(int i = 0; i < vert.Count; i++) {
            writer.WriteLine(vert[i]);
          }

          writer.WriteLine("");
          writer.WriteLine("g " + in_name + n.ToString());

          for(int i = 0; i < face.Count; i++) {
            writer.WriteLine(face[i]);
          }
          faceCount += in_mesh[n].Vertices.Count;
        }
      }
    }
    A = path;
# ---------- c_script_2: C# additional code ----------
  String path;
# ---------- end c_script_2 ----------
python_7 = GhPythonScript(
    texts=c_script.text,
    locations=c_script.plane,
    layerNames=python_3.full_name,
    lines=crv,
    lineNames=python_2.full_name,
    writeJson=Button(),
    address="/Users/yang/Desktop")  # -> out, a; inputs texts: list, locations: list of Point3d, layerNames: list, lines: list of Line, writeJson: Boolean
# ---------- python_7: Python ----------
__author__ = "yang"

import rhinoscriptsyntax as rs
import Rhino.Geometry as rg
import json
import os

#seperate them into lists according to layers
sortedNames = []
for name in layerNames:
    if name in sortedNames:
        pass
    else:
        sortedNames.append(name)

sortedTexts = []
sortedLocations = []
for i in range(len(sortedNames)):
    sortedText = []
    sortedLocation = []
    for j in range(len(layerNames)):
        if layerNames[j] == sortedNames[i]:
            sortedText.append(texts[j]) 
            sortedLocation.append(locations[j])
    sortedTexts.append(sortedText)
    sortedLocations.append(sortedLocation)

if writeJson:
    for j in range(len(sortedTexts)):
        text = sortedTexts[j]
        location = sortedLocations[j]
        name = sortedNames[j]
        a = []
        for i in range(len(text)):
        
            b = {
            "text":text[i],
            "pt":[location[i].X, location[i].Y, location[i].Z]}
            
            a.append(b)
        
        a = {"text3d": a}
        jsonObj = json.dumps(a, indent=4)
        
        fileName = name
        path = os.path.join(address, "text_" + fileName+".json")
        
        with open(path, "w") as outFile:
            outFile.write(jsonObj)
# ---------- end python_7 ----------
python_8 = GhPythonScript(lines=crv_2, writeJson=button_2, fileName=python.full_name, address="/Users/yang/Desktop/")  # -> out, a; inputs lines: list of Line, writeJson: Boolean, fileName: list; same code as python_5
list_item = ListItem(List=panel_3, Index=Slider(5, range=0..6), Wrap=True)
ghpython_script_2 = GhPythonScript()  # -> Out, A
panel_5 = Panel(list_item)
